# Grasshopper definition axis_generator.gh (Grasshopper 1.0.7)
# plug-ins: Pufferfish

beam_width_mm = Slider(36, range=0..100)
beam_thickness_mm = Slider(12, range=0..100)

# ---- group: Rack Generator
# curve tail
# Repeating Wave
rack_width_mm_1inch = Slider(15, range=0..100)
number_of_teeth = Slider(154, range=0..500)
start = Curve([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])
brec = BoundingRectangle(Geometry=start, Plane=PlaneXY(0, 0, 0), Axis=0, Slide=0, Union=True)  # -> Bounding, DimensionX, DimensionY
holes_count = Slider(59, range=0..100)
holes_step = Slider(20, range=0..100)
hole_d = Slider(3, range=0..8)
vec = VectorXYZ(XComponent=brec.DimensionX, YComponent=0, ZComponent=0)  # -> Vector, Length
arrlinear = LinearArray(Geometry=start, Direction=vec.Vector, Count=number_of_teeth)  # -> Geometry, Transform
series = Series(Start=0, Step=holes_step, Count=expr("x/2", holes_count))
join = JoinCurves(Curves=flatten(arrlinear.Geometry), Preserve=False)
neg = Negative(Value=series)
curvepoint = PointOnCurve(join, parameter=0)
start_2 = Curve(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)
X = UnitX(Factor=[neg, series])
curvepoint_2 = PointOnCurve(start_2, parameter=1)
move2pt = MoveToPoint(Geometry=start_2, PointA=curvepoint_2, PointB=curvepoint)  # -> Moved, Vector, Transform
neg_2 = Negative(Value=rack_width_mm_1inch)
join_2 = JoinCurves(Curves=flatten([join, move2pt.Moved]), Preserve=False)
Y = UnitY(Factor=neg_2)
curvepoint_3 = PointOnCurve(join_2, parameter=0)
curvepoint_4 = PointOnCurve(join_2, parameter=1)
move = Move(Geometry=curvepoint_4, Motion=Y)  # -> Geometry, Transform
move_2 = Move(Geometry=curvepoint_3, Motion=Y)  # -> Geometry, Transform
ln = Line(StartPoint=curvepoint_3, EndPoint=move_2.Geometry)
ln_2 = Line(StartPoint=move_2.Geometry, EndPoint=move.Geometry)
len = Length(Curve=ln_2)
length_of_the_rack_mm = Panel(len)
ln_3 = Line(StartPoint=curvepoint_4, EndPoint=move.Geometry)
merge = Merge(Data1=ln, Data2=ln_2, Data3=ln_3, Data5=join_2)
join_3 = JoinCurves(Curves=flatten(merge), Preserve=False)
area = Area(Geometry=join_3)  # -> Area, Centroid
cir = Circle(Plane=area.Centroid, Radius=expr("x/2", hole_d))
move_3 = Move(Geometry=cir, Motion=X)  # -> Geometry, Transform
group = Group(Objects=flatten([join_3, move_3.Geometry]))

# ----
crv = Curve([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])
brep = Brep(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)
crv_2 = Curve(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)
plywood_s_e_parallel = Panel("X")
plywood_s_e_perpendicular = Panel("Y")
carrige_mass_g = Panel("Z")
Z = UnitZ(Factor=beam_thickness_mm)
pt = ConstructPoint(XCoordinate=length_of_the_rack_mm, YCoordinate=beam_width_mm, ZCoordinate=0)
rec_2pt = Rectangle2Pt(Plane=PlaneXY(0, 0, 0), PointA=move.Geometry, PointB=pt, Radius=0)  # -> Rectangle, Length
extr = Extrude(Base=rec_2pt.Rectangle, Direction=Z)
extr_2 = Extrude(Base=move_3.Geometry, Direction=expr("x*3", Z))
cap = CapHoles(Brep=extr)
depth_of_the_holes = Slider(6, range=0..10)
area_2 = Area(Geometry=move_3.Geometry)  # -> Area, Centroid
Z_2 = UnitZ(Factor=1)
cap_2 = CapHoles(Brep=extr_2)
pdecon = Deconstruct(Point=area_2.Centroid)  # -> XComponent, YComponent, ZComponent
export = Merge(Data1=group, Data2=rec_2pt.Rectangle)
pt_2 = ConstructPoint(XCoordinate=pdecon.XComponent, YCoordinate=pdecon.YComponent, ZCoordinate=expr("x-1", pdecon.ZComponent))
cyl = Cylinder(Base=pt_2, Radius=expr("x+1", hole_d), Length=expr("x+1", depth_of_the_holes))
cap_3 = CapHoles(Brep=cyl)
sunion = SolidUnion(Breps=graft([cap_2, cap_3]))
sdiff = SolidDifference(BrepsA=cap, BrepsB=flatten(sunion))
preview = CustomPreview(Geometry=sdiff, Material=ColourSwatch(SwatchColor=RGB(217, 89, 89)))
